# Grasshopper definition SurfaceCreation_Manual.gh (Grasshopper 1.0.7)

pipeline = GeometryPipeline(
    GroupByLayer=False,
    GroupByType=False,
    IncludeHidden=True,
    IncludeLocked=True,
    LayerFilter="CreateSurf",
    NameFilter="*",
    SublayerFiltering=True,
    TypeFilter=4)
join = JoinCurves(Curves=pipeline, Preserve=False)
tmatch = MatchText(Text=join, Pattern="*Polyline*", Case=True)
number_slider = Slider(1.5, range=0..3)
mindex = MemberIndex(Set=tmatch, Member=Toggle(False))  # -> Index, Count
cull_i = CullIndex(List=join, Indices=mindex.Index, Wrap=True)
multiplication = Multiplication(A=Slider(-1, range=-1..1), B=number_slider)
crv = Curve(cull_i)
cull_validation_initial_geo = Panel(cull_i)
offset = OffsetCurve(Curve=crv, Distance=multiplication, Plane=PlaneXY(0, 0, 0), Corners=1)
offset_2 = OffsetCurve(Curve=crv, Distance=number_slider, Plane=PlaneXY(0, 0, 0), Corners=1)
loft = Loft(
    Curves=[offset, offset_2],
    Options={Adjust=False, Closed=False, LoftEnds=0, LoftSimp=0, LoftType=0, Rebuild=10, Refit=0.01})  # -> flatten(Loft)
null = NullItem(Item=loft)  # -> NullFlags, InvalidFlags, Description
all_line_loft_attempts = Panel(loft)
mindex_2 = MemberIndex(Set=null.NullFlags, Member=Toggle(True))  # -> Index, Count
cull_i_2 = CullIndex(List=loft, Indices=mindex_2.Index, Wrap=True)
cull_validation_final_geo = Panel(cull_i_2)
